# Dynamo graph 2.0.2 - 3D Views from Schedules.dyn (Dynamo 2.0.2.6826)

# note: Nodes not to consider part of the final graph

# group: NOTES
# note: INSTRUCTIONS
# - Het betreft de tabellen in de Project Browser Schedules
# note: GENERAL INFO
# Version: 1.0.0
# Author: Yahya Kiliç
# Company: Dura Vermeer
# email: y.kilic@duravermeer.nl
# Dynamo version: 2.0.2
# Revit version: 2018.3
# note: UITGANGSPUNTEN
#  - Het script genereert meerdere 3D views vanuit de Schedules

# group: DEBUG
# note: Check if the graph is working as expected

# group: INPUT
# note: Data input and preparation for other nodes

# group: OUTPUT
# note: Objects creation in Revit, final output

# group: SET
# note: Set parameters on Revit objects

# group: FUNCTION
# note: Data manipulation on Dynamo objects

# group: GET
# note: Get parameter values from Revit objects

# group: Vind alle schedules in het project
builtInCategory = CodeBlock { "OST_Schedules"; }
byName = Category.ByName(name=builtInCategory)
all_elements_of_category = ElementsOfCategory(Category=byName)
string_from_object = FromObject()  # unwired: obj
sortByFunction = List.SortByFunction(list=all_elements_of_category, func=string_from_object)
code_block = CodeBlock { 1; }
shiftIndices = List.ShiftIndices(list=sortByFunction, amount=code_block)

# group: Filtert alle Key Schedules eruit
name = Element.Name(element=shiftIndices)
find_keyschedule_py = Python(IN[0]=shiftIndices)
# ---------- find_keyschedule_py.python (12 lines) ----------
import clr
clr.AddReference('RevitAPI')
from Autodesk.Revit.DB import *

def GetKeyScheduleParamName(schedule):
	if hasattr(schedule, "KeyScheduleParameterName"): return schedule.KeyScheduleParameterName
	else: return None

scheds = UnwrapElement(IN[0])

if isinstance(IN[0], list): OUT = [GetKeyScheduleParamName(x) for x in scheds]
else: OUT = GetKeyScheduleParamName(scheds)
# ----------------------------------------
code_block_2 = CodeBlock { "Yahya"; }
list_replacenull_py = Python(IN[0]=find_keyschedule_py, IN[1]=code_block_2)
# ---------- list_replacenull_py.python (8 lines) ----------
items = IN[0]
rep = IN[1]
elementlist = list()
for item in items:
	if item is None: 
		item = rep
	elementlist.append(item)
OUT = elementlist
# ----------------------------------------
contains = String.Contains(str=name, searchFor=list_replacenull_py, lacing=Longest)
filterByBoolMask = List.FilterByBoolMask(list=shiftIndices, mask=contains)

# group: Vind alle elementen van de onderstaande categories
builtincategory_list = CodeBlock()
# ---------- builtincategory_list.designscript (1 lines) ----------
["OST_StructuralFraming", "OST_GenericModel", "OST_Roofs", "OST_Windows", "OST_Walls", "OST_Doors", "OST_Floors", "OST_ElectricalEquipment", "OST_Site", "OST_Stairs", "OST_StairsRailing", "OST_PipeAccessory", "OST_CurtainWallMullions", "OST_CurtainWallPanels", "OST_Ramps", "OST_Mass", "OST_Columns", "OST_FurnitureSystems", "OST_SpecialityEquipment", "OST_StructuralFoundation", "OST_Furniture", "OST_StructuralColumns", "MechanicalEquipment"];
# ----------------------------------------
byName_2 = Category.ByName(name=builtincategory_list)
categorie_naar_keuze_01 = Categories(index=0)  # graph input
categorie_naar_keuze_02 = Categories(index=0)  # graph input
categorie_naar_keuze_03 = Categories(index=0)  # graph input
list_create = List.Create(item0=byName_2, item1=categorie_naar_keuze_01, item2=categorie_naar_keuze_02, item3=categorie_naar_keuze_03)
all_elements_of_category_2 = ElementsOfCategory(Category=list_create)

# group: Vult parameteter "ID element" in met het ID nummer van het element
code_block_3 = CodeBlock { "ID element"; }
code_block_4 = CodeBlock { false; }
clean = List.Clean(list=all_elements_of_category_2, preserveIndices=code_block_4)
id = Element.Id(element=clean)
string_from_object_2 = FromObject(obj=id)
setParameterByName = Element.SetParameterByName(element=all_elements_of_category_2, parameterName=code_block_3, value=string_from_object_2)

code_block_5 = CodeBlock(passthrough=filterByBoolMask.out, waitfor=setParameterByName) { [passthrough,waitfor][0]; }

# group: Itemize every instance vinkje aan
boolean = BoolSelector(true)
python_script = Python(IN[0]=code_block_5, IN[1]=boolean)
# ---------- python_script.python (31 lines) ----------
import clr

# Import DocumentManager and TransactionManager
clr.AddReference("RevitServices")
import RevitServices
from RevitServices.Persistence import DocumentManager
from RevitServices.Transactions import TransactionManager
doc = DocumentManager.Instance.CurrentDBDocument

ProcessLists = lambda function, lists: [ProcessLists(function, item) if isinstance(item, list) else function(item) for item in lists]
ApplyFunction = lambda func, objs: ProcessLists(func, objs) if isinstance(objs, list) else [func(objs)]

def Unwrap(item):
    return UnwrapElement(item)
    
if isinstance(IN[0], list):
	schedule = ProcessLists(Unwrap, IN[0])
else:
	schedule = Unwrap(IN[0])

itemize = IN[1]
	
def task(schedule):
	definition = schedule.Definition
	result = definition
	TransactionManager.Instance.EnsureInTransaction(doc)
	result.IsItemized = itemize
	TransactionManager.Instance.TransactionTaskDone()
	return result

OUT = ApplyFunction(task,schedule)
# ----------------------------------------

# group: Selecteert 3D View _totaal in export voor duplicate
python_script_2 = Python()  # unwired: IN[0]
# ---------- python_script_2.python (47 lines) ----------
import clr
clr.AddReference('ProtoGeometry')
from Autodesk.DesignScript.Geometry import *

# Import DocumentManager and TransactionManager
clr.AddReference("RevitServices")
import RevitServices
from RevitServices.Persistence import DocumentManager
from RevitServices.Transactions import TransactionManager

# Import RevitAPI
clr.AddReference("RevitAPI")
import Autodesk
from Autodesk.Revit.DB import *

doc = DocumentManager.Instance.CurrentDBDocument
uiapp = DocumentManager.Instance.CurrentUIApplication
app = uiapp.Application

from System.Collections.Generic import *

# Import ToDSType(bool) extension method
clr.AddReference("RevitNodes")
import Revit
clr.ImportExtensions(Revit.Elements)

#The inputs to this node will be stored as a list in the IN variable.
# dataEnteringNode = IN

#collect all views in the model
ViewCollector = FilteredElementCollector(doc)
views = ViewCollector.OfClass(View).ToElements()

ViewIsThreeD = []
AllOtherViews = []

for v in ViewCollector:
                if not v.IsTemplate:
                                if v.ViewType == ViewType.ThreeD:
                                                ViewIsThreeD.append(v.ToDSType(True))
                                if v.ViewType is not ViewType.ThreeD:
                                                AllOtherViews.append(v)
                                else:
                                                continue
BigList = ViewIsThreeD
#Assign your output to the OUT variable.
OUT = BigList
# ----------------------------------------
code_block_6 = CodeBlock { "browsermap_hoofd"; }
getParameterValueByName = Element.GetParameterValueByName(element=python_script_2, parameterName=code_block_6)
code_block_7 = CodeBlock { "_export"; }
contains_2 = String.Contains(str=getParameterValueByName, searchFor=code_block_7)
filterByBoolMask_2 = List.FilterByBoolMask(list=python_script_2, mask=contains_2)
name_2 = Element.Name(element=filterByBoolMask_2.in)
code_block_8 = CodeBlock { "_totaal"; }
contains_3 = String.Contains(str=name_2, searchFor=code_block_8)
filterByBoolMask_3 = List.FilterByBoolMask(list=filterByBoolMask_2.in, mask=contains_3)

# group: Parameter Bloknummer + Projectnaam aflezen in Project Information
builtInCategory_2 = CodeBlock { "OST_ProjectInformation"; }
byName_3 = Category.ByName(name=builtInCategory_2)
all_elements_of_category_3 = ElementsOfCategory(Category=byName_3)
code_block_9 = CodeBlock { ["Building Name", "Project Number"]; }
getParameterValueByName_2 = Element.GetParameterValueByName(element=all_elements_of_category_3, parameterName=code_block_9@L1)
flatten = List.Flatten(list=getParameterValueByName_2)
firstItem = List.FirstItem(list=flatten)
code_block_10 = CodeBlock { "_"; }
lastItem = List.LastItem(list=flatten)
concat = String.Concat(string0=firstItem, string1=code_block_10, string2=lastItem, string3=code_block_10)

# group: 3D views benamingen afkorten
code_block_11 = CodeBlock { "View Name"; }
code_block_12 = CodeBlock { "BLOKNUMMER_PROJECTNAAM_"; }
replace = String.Replace(str=name_2@L1, searchFor=code_block_12, replaceWith=concat)
code_block_13 = CodeBlock { "bouwkundig"; }
code_block_14 = CodeBlock { "bwk"; }
replace_2 = String.Replace(str=replace, searchFor=code_block_13, replaceWith=code_block_14)
code_block_15 = CodeBlock { "constructief"; }
code_block_16 = CodeBlock { "con"; }
replace_3 = String.Replace(str=replace_2, searchFor=code_block_15, replaceWith=code_block_16)
code_block_17 = CodeBlock { "installaties"; }
code_block_18 = CodeBlock { "inst"; }
replace_4 = String.Replace(str=replace_3, searchFor=code_block_17, replaceWith=code_block_18)
setParameterByName_2 = Element.SetParameterByName(element=filterByBoolMask_2.in, parameterName=code_block_11, value=replace_4)

# group: vind alle 3D Views
element_types = ElementTypes(index=326)

code_block_19 = CodeBlock(passthrough=element_types, waitfor=setParameterByName) { [passthrough,waitfor][0]; }

# group (continued): vind alle 3D Views
all_elements_of_type = ElementsOfType(element_type=code_block_19)
isNull = Object.IsNull(obj=all_elements_of_type)
filterByBoolMask_4 = List.FilterByBoolMask(list=all_elements_of_type, mask=isNull)

# group: Selecteert alle 3D views in 99 of 100 export
code_block_20 = CodeBlock { "browsermap_hoofd"; }
getParameterValueByName_3 = Element.GetParameterValueByName(element=filterByBoolMask_4.out, parameterName=code_block_20)
code_block_21 = CodeBlock { "_export"; }
contains_4 = String.Contains(str=getParameterValueByName_3, searchFor=code_block_21)
filterByBoolMask_5 = List.FilterByBoolMask(list=filterByBoolMask_4.out, mask=contains_4)

# group: Trefwoorden om Schedules te kunnen aflezen
metselwerk = BoolSelector(true)  # graph input
gevelisolatie = BoolSelector(true)  # graph input
HSB = BoolSelector(true)  # graph input
binnenwanden = BoolSelector(true)  # graph input
binnendeuren = BoolSelector(true)  # graph input
dekvloeren = BoolSelector(true)  # graph input
dakpannen = BoolSelector(true)  # graph input
goot = BoolSelector(true)  # graph input
dakraam = BoolSelector(true)  # graph input
gevelpan = BoolSelector(true)  # graph input
waterslag = BoolSelector(true)  # graph input
vensterbank = BoolSelector(true)  # graph input
trappen = BoolSelector(true)  # graph input
spekband = BoolSelector(true)  # graph input
betonlatei = BoolSelector(true)  # graph input
pv_panelen = BoolSelector(true)  # graph input
nokvorst = BoolSelector(false)  # graph input
muurplaat = BoolSelector(false)  # graph input
knieschot = BoolSelector(false)  # graph input
tegelwerk = BoolSelector(false)  # graph input
dakkapel = BoolSelector(false)  # graph input
luifel = BoolSelector(false)  # graph input
schoorsteen = BoolSelector(false)  # graph input
n01 = BoolSelector(false)  # "01"; graph input
n02 = BoolSelector(false)  # "02"; graph input
n03 = BoolSelector(false)  # "03"; graph input
join = List.Join(list0=metselwerk, list1=gevelisolatie, list2=HSB, list3=binnenwanden, list4=binnendeuren, list5=dekvloeren, list6=dakpannen, list7=goot, list8=dakraam, list9=gevelpan, list10=waterslag, list11=vensterbank, list12=trappen, list13=spekband, list14=betonlatei, list15=pv_panelen, list16=nokvorst, list17=muurplaat, list18=knieschot, list19=tegelwerk, list20=dakkapel, list21=luifel, list22=schoorsteen, list23=n01, list24=n02, list25=n03)
code_block_22 = CodeBlock()
# ---------- code_block_22.designscript (45 lines) ----------
"metselwerk";

"isolatie";

"hsb";

"binnenwanden, niet";

"binnendeuren";

"dekvloeren";

"47_RO - daken, niet";

"goot";

"dakraam";

"gevelpan";

"waterslag";

"vensterbank";

"trappen";

"spekband";

"betonlatei";

"pv panelen";

"nokvorst";

"muurplaat";

"knieschot";

"tegels";

"luifel";

"dakkapel";

"schoorsteen";
# ----------------------------------------
schedule_naar_keuze_01 = StringInput("<naam invullen en zet op True>")  # graph input
schedule_naar_keuze_02 = StringInput("<naam invullen en zet op True>")  # graph input
schedule_naar_keuze_03 = StringInput("<naam invullen en zet op True>")  # graph input
join_2 = List.Join(list0=code_block_22.out0, list1=code_block_22.out1, list2=code_block_22.out2, list3=code_block_22.out3, list4=code_block_22.out4, list5=code_block_22.out5, list6=code_block_22.out6, list7=code_block_22.out7, list8=code_block_22.out8, list9=code_block_22.out9, list10=code_block_22.out10, list11=code_block_22.out11, list12=code_block_22.out12, list13=code_block_22.out13, list14=code_block_22.out14, list15=code_block_22.out15, list16=code_block_22.out16, list17=code_block_22.out17, list18=code_block_22.out18, list19=code_block_22.out19, list20=code_block_22.out20, list21=code_block_22.out21, list22=code_block_22.out22, list23=schedule_naar_keuze_01, list24=schedule_naar_keuze_02, list25=schedule_naar_keuze_03)
code_block_23 = CodeBlock(view=join, naam=join_2) { view == true; naam; null; }
if_ = If(test=code_block_23.out0, true=code_block_23.naam, false=code_block_23.out2)
code_block_24 = CodeBlock(naam=if_) { naam != null; }
filterByBoolMask_6 = List.FilterByBoolMask(list=if_, mask=code_block_24)

# group: Schedules worden gefilterd met de gekozen trefwoorden
string_from_object_3 = FromObject(obj=shiftIndices)
contains_5 = String.Contains(str=string_from_object_3, searchFor=filterByBoolMask_6.in@L1)
filterByBoolMask_7 = List.FilterByBoolMask(list=shiftIndices, mask=contains_5@L2)
isEmpty = List.IsEmpty(list=filterByBoolMask_7.in@L2)
filterByBoolMask_8 = List.FilterByBoolMask(list=filterByBoolMask_7.in, mask=isEmpty)
name_3 = Element.Name(element=filterByBoolMask_8.out)
code_block_25 = CodeBlock { 1; }
removeItemAtIndex = List.RemoveItemAtIndex(list=name_3@L2, indices=code_block_25)
contains_6 = String.Contains(str=removeItemAtIndex@L1, searchFor=filterByBoolMask_6.in)
filterByBoolMask_9 = List.FilterByBoolMask(list=filterByBoolMask_6.in, mask=contains_6@L2)

# group: Views benamingen wijzigen
code_block_26 = CodeBlock { "isolatie"; }
code_block_27 = CodeBlock { "gevelisolatie"; }
replace_5 = String.Replace(str=filterByBoolMask_9.in, searchFor=code_block_26, replaceWith=code_block_27)
code_block_28 = CodeBlock { "binnenwanden, niet"; }
code_block_29 = CodeBlock { "binnenwanden"; }
replace_6 = String.Replace(str=replace_5, searchFor=code_block_28, replaceWith=code_block_29)
code_block_30 = CodeBlock { "tegels"; }
code_block_31 = CodeBlock { "tegelwerk"; }
replace_7 = String.Replace(str=replace_6, searchFor=code_block_30, replaceWith=code_block_31)
code_block_32 = CodeBlock { "47_RO - daken, niet"; }
code_block_33 = CodeBlock { "dakpannen"; }
replace_8 = String.Replace(str=replace_7, searchFor=code_block_32, replaceWith=code_block_33)
naam_schedule_01 = StringInput("<Naam invullen van de Schedule>")  # graph input
benaming_3d_view_01 = StringInput("<Vervangen met>")  # graph input
replace_9 = String.Replace(str=replace_8, searchFor=naam_schedule_01, replaceWith=benaming_3d_view_01)
naam_schedule_02 = StringInput("<Naam invullen van de Schedule>")  # graph input
benaming_3d_view_02 = StringInput("<Vervangen met>")  # graph input
replace_10 = String.Replace(str=replace_9, searchFor=naam_schedule_02, replaceWith=benaming_3d_view_02)
naam_schedule_03 = StringInput("<Naam invullen van de Schedule>")  # graph input
benaming_3d_view_03 = StringInput("<Vervangen met>")  # graph input
replace_11 = String.Replace(str=replace_10, searchFor=naam_schedule_03, replaceWith=benaming_3d_view_03)

# group: 3D views benamingen combineren
count = List.Count(list=replace_11)
ofRepeatedItem = List.OfRepeatedItem(item=concat, amount=count)
code_block_34 = CodeBlock(a=ofRepeatedItem, b=replace_11) { a+b; }
flatten_2 = List.Flatten(list=code_block_34)
firstItem_2 = List.FirstItem(list=filterByBoolMask_3.in)

# group: Verwijderd eerder gegenereerde 3D views
name_4 = Element.Name(element=filterByBoolMask_5.in)
contains_7 = String.Contains(str=name_4@L1, searchFor=flatten_2)
code_block_35 = CodeBlock { true; }
contains_8 = List.Contains(list=contains_7@L2, item=code_block_35)
filterByBoolMask_10 = List.FilterByBoolMask(list=filterByBoolMask_5.in, mask=contains_8)
verwijder_eerder_gegenereerde_3d = BoolSelector(false)  # "Verwijder eerder gegenereerde 3D views"; graph input
python_script_3 = Python(IN[0]=filterByBoolMask_10.in, IN[1]=verwijder_eerder_gegenereerde_3d)
# ---------- python_script_3.python (35 lines) ----------
#Copyright(c) 2016, Dimitar Venkov
# @5devene, dimitar.ven@gmail.com

import clr

clr.AddReference("RevitServices")
import RevitServices
from RevitServices.Persistence import DocumentManager
from RevitServices.Transactions import TransactionManager
doc = DocumentManager.Instance.CurrentDBDocument

def tolist(obj1):
	if hasattr(obj1,"__iter__"): return obj1
	else: return [obj1]

elems = UnwrapElement(tolist(IN[0]) )

if IN[1]:
	deleted, failed = [], []
	TransactionManager.Instance.EnsureInTransaction(doc)
	for e in elems:
		id = None
		try:
			id = e.Id
			del_id = doc.Delete(id)
			deleted.extend([d.ToString() for d in del_id])
		except:
			if id is not None:
				failed.append(id.ToString() )
	TransactionManager.Instance.TransactionTaskDone()
	s = set(deleted)
	failed1 = [x for x in failed if x not in s]
	OUT = len(deleted), ';'.join(deleted), ';'.join(failed1)
else:
	OUT = "Set confirm to True", "", ""
# ----------------------------------------

# group: 3D view _totaal dupliceren
python_script_4 = Python(IN[0]=firstItem_2, IN[1]=flatten_2)
# ---------- python_script_4.python (32 lines) ----------
import clr
clr.AddReference('RevitAPI')
from Autodesk.Revit.DB import *
import Autodesk

clr.AddReference("RevitServices")
import RevitServices
from RevitServices.Persistence import DocumentManager
from RevitServices.Transactions import TransactionManager

def DuplicateView(view, name, doc):
	try:
		newViewId = view.Duplicate(Autodesk.Revit.DB.ViewDuplicateOption.Duplicate)
		newView = doc.GetElement(newViewId)
		try: newView.Name = name
		except: pass
		return newView
	except: return None

doc = DocumentManager.Instance.CurrentDBDocument
views = UnwrapElement(IN[0])

TransactionManager.Instance.EnsureInTransaction(doc)
if isinstance(IN[0], list):
	OUT = []
	for view, name in zip(views, IN[1]):
		if isinstance(name, list): OUT.append([DuplicateView(view, x, doc) for x in name])
		else: OUT.append(DuplicateView(view, name, doc))
else: 
	if isinstance(IN[1], list): OUT = [DuplicateView(views, x, doc) for x in IN[1]]
	else: OUT = DuplicateView(views, IN[1], doc)
TransactionManager.Instance.TransactionTaskDone()
# ----------------------------------------

code_block_36 = CodeBlock(passthrough=filterByBoolMask_8.out, waitfor=setParameterByName) { [passthrough,waitfor][0]; }

# group: Alleen 3e kolom van de schedules (ID element)
python_script_5 = Python(IN[0]=code_block_36)
# ---------- python_script_5.python (50 lines) ----------
import clr
clr.AddReference('ProtoGeometry')
from Autodesk.DesignScript.Geometry import *

# Import DocumentManager and TransactionManager
clr.AddReference("RevitServices")
import RevitServices
from RevitServices.Persistence import DocumentManager
from RevitServices.Transactions import TransactionManager
from System.Collections.Generic import *
#
# Import RevitAPI
clr.AddReference("RevitAPI")
import Autodesk
from Autodesk.Revit.DB import *

doc = DocumentManager.Instance.CurrentDBDocument
uiapp = DocumentManager.Instance.CurrentUIApplication
app = uiapp.Application

list_schedules = IN[0]
result = []

for schedules in list_schedules :
	mini_result = []
	for schedule in schedules :
		schedule = UnwrapElement(schedule)
	
		# "Start" the transaction
		TransactionManager.Instance.EnsureInTransaction(doc)
		
		#count the number of rows and columns in the schedule
		table = schedule.GetTableData().GetSectionData(SectionType.Body)
		nRows = table.NumberOfRows
		nColumns = table.NumberOfColumns
	
		#Collect all of data from the schedule
		dataListRow = []
		for row in range(nRows): #Iterate through the rows. The second row is always a blank space
			dataListColumn = []
			for column in range(nColumns): #Iterate through the columns
				dataListColumn.Add( TableView.GetCellText(schedule, SectionType.Body, row, column) )
			dataListRow.Add( dataListColumn );

		# "End" the transaction
		TransactionManager.Instance.TransactionTaskDone()
		mini_result.append(dataListRow)
	result.append(mini_result)

OUT = result
# ----------------------------------------
code_block_37 = CodeBlock { 2; }
getItemAtIndex = List.GetItemAtIndex(list=python_script_5@@L2, index=code_block_37)

# group: Zet de ID nummers om naar daadwerkelijke elementen
code_block_38 = CodeBlock { "ID element"; }
contains_9 = List.Contains(list=getItemAtIndex@@L1, item=code_block_38)
filterByBoolMask_11 = List.FilterByBoolMask(list=getItemAtIndex, mask=contains_9)
length = String.Length(str=filterByBoolMask_11.out)
code_block_39 = CodeBlock { 0; }
eq = length == code_block_39
filterByBoolMask_12 = List.FilterByBoolMask(list=filterByBoolMask_11.out, mask=eq)
code_block_40 = CodeBlock { 1; }
flatten_3 = List.Flatten(list=filterByBoolMask_12.out@@L3, amt=code_block_40)
toNumber = String.ToNumber(str=flatten_3)
code_block_41 = CodeBlock(idnum=toNumber) { Revit.ElementSelector.ByElementId(idnum); }

# group: Permanent isolate van de 3D views
code_block_42 = CodeBlock(view=python_script_4) { view; }
code_block_43 = CodeBlock(element=code_block_41) { element; }
python_script_6 = Python(IN[0]=code_block_43, IN[1]=code_block_42)
# ---------- python_script_6.python (27 lines) ----------
import clr
clr.AddReference('RevitAPI')
from Autodesk.Revit.DB import *
from System.Collections.Generic import *

clr.AddReference("RevitServices")
import RevitServices
from RevitServices.Persistence import DocumentManager
from RevitServices.Transactions import TransactionManager

def TempIsolateElements(view, items):
	if not items: return False
	elif not isinstance(items, list): items = [items]
	ielements = List[ElementId]([x.Id for x in UnwrapElement(items)])
	try:
		UnwrapElement(view).IsolateElementsTemporary(ielements)
		return True
	except: return False

doc = DocumentManager.Instance.CurrentDBDocument

TransactionManager.Instance.EnsureInTransaction(doc)
if isinstance(IN[1], list):
	if isinstance(IN[0], list): OUT = [TempIsolateElements(x, y) for x, y in zip(IN[1], IN[0])]
	else: OUT = [TempIsolateElements(x, IN[0]) for x in IN[1]]
else: OUT = TempIsolateElements(IN[1], IN[0])
TransactionManager.Instance.TransactionTaskDone()
# ----------------------------------------
code_block_44 = CodeBlock(passthrough=code_block_42, waitfor=python_script_6) { [passthrough,waitfor][0]; }
python_script_7 = Python(IN[0]=code_block_44)
# ---------- python_script_7.python (22 lines) ----------
import clr
clr.AddReference('RevitAPI')
from Autodesk.Revit.DB import *

clr.AddReference("RevitServices")
import RevitServices
from RevitServices.Persistence import DocumentManager
from RevitServices.Transactions import TransactionManager

def TempHideIsolateToPerm(view):
	try:
		view.ConvertTemporaryHideIsolateToPermanent()
		return True
	except: return False

doc = DocumentManager.Instance.CurrentDBDocument
views = UnwrapElement(IN[0])

TransactionManager.Instance.EnsureInTransaction(doc)
if isinstance(IN[0], list): OUT = [TempHideIsolateToPerm(x) for x in views]
else: OUT = TempHideIsolateToPerm(views)
TransactionManager.Instance.TransactionTaskDone()
# ----------------------------------------

code_block_45 = CodeBlock(passthrough=filterByBoolMask.out, waitfor=python_script_7) { [passthrough,waitfor][0]; }

# group: Itemize every instance vinkje uit
boolean_2 = BoolSelector(false)
python_script_8 = Python(IN[0]=code_block_45, IN[1]=boolean_2)  # same code as python_script
