# Dynamo graph 2.0.2 - Gespiegelde binnendeuren.dyn (Dynamo 2.0.2.6826)

# note: Nodes not to consider part of the final graph

# group: NOTES
# note: INSTRUCTIONS
# - Het script zoekt alle deurenfamilies in de template en filtert op “NLRS_32” (binnendeuren)
# - Vervolgens filtert het op de types en maakt een vergelijking met de deuren die in het model worden gebruikt.
# - Alle binnendeuren die uit de filter komen krijgen merktype “linksdraaind”
# - Vervolgens wordt er gezocht naar de gespiegelde deuren en krijgen alle gepiegelde deuren het merk type “rechtsdraaiend”
# note: GENERAL INFO
# Version: 1.0.0
# Author: Yahya Kiliç
# Company: Dura Vermeer
# email: y.kilic@duravermeer.nl
# Dynamo version: 2.0.2
# Revit version: 2018.3
# note: UITGANGSPUNTEN
#  - Dit script is voor het invullen van de parameter "linksdraaiend en/of rechtsdraaiend" en het bouwnummer.
# - Dit script gaat vanuit dat het een standaard linksdraaind deur is.

# group: FUNCTION
# note: Data manipulation on Dynamo objects

# group: DEBUG
# note: Check if the graph is working as expected

# group: OUTPUT
# note: Objects creation in Revit, final output

# group: SET
# note: Set parameters on Revit objects

# group: INPUT
# note: Data input and preparation for other nodes

# group: GET
# note: Get parameter values from Revit objects

# group: Zoekt alle familie deuren
builtInCategory = CodeBlock { "OST_Doors"; }
byName = Category.ByName(name=builtInCategory)
boolean = BoolSelector(true)
python_script = Python(IN[0]=byName, IN[1]=boolean)  # unwired: IN[2]
# ---------- python_script.python (21 lines) ----------
import System
import clr
clr.AddReference('RevitAPI')
from Autodesk.Revit.DB import *

clr.AddReference("RevitServices")
import RevitServices
from RevitServices.Persistence import DocumentManager

def ElementTypesByCategory(cat, doc):
	collector = FilteredElementCollector(doc).OfClass(Family)
	return [x for x in collector.ToElements() if x.FamilyCategoryId.IntegerValue == cat.Id]

inputdoc = UnwrapElement(IN[2])
if not inputdoc: doc = DocumentManager.Instance.CurrentDBDocument
elif inputdoc.GetType().ToString() == "Autodesk.Revit.DB.RevitLinkInstance": doc = inputdoc.GetLinkDocument()
elif inputdoc.GetType().ToString() == "Autodesk.Revit.DB.Document": doc = inputdoc
else: doc = DocumentManager.Instance.CurrentDBDocument

if isinstance(IN[0], list): OUT = [ElementTypesByCategory(x, doc) for x in IN[0]]
else: OUT = ElementTypesByCategory(IN[0], doc)
# ----------------------------------------

# group: Zoekt familie: NLRS_32 (binnendeur)
name = Element.Name(element=python_script)
code_block = CodeBlock { "NLRS_32_"; }
contains = String.Contains(str=name@L1, searchFor=code_block)
filterByBoolMask = List.FilterByBoolMask(list=python_script, mask=contains)

# group: Filtert alle familietypes
types = Family.Types(family=filterByBoolMask.in)
code_block_2 = CodeBlock { -1; }
flatten = List.Flatten(list=types, amt=code_block_2)
name_2 = Element.Name(element=flatten)

# group: Filtert alle binnendeuren in het model
builtInCategory_2 = CodeBlock { "OST_Doors"; }
byName_2 = Category.ByName(name=builtInCategory_2)
all_elements_of_category = ElementsOfCategory(Category=byName_2)
name_3 = Element.Name(element=all_elements_of_category)
contains_2 = String.Contains(str=name_3@L1, searchFor=name_2)
code_block_3 = CodeBlock { true; }
contains_3 = List.Contains(list=contains_2@L2, item=code_block_3)
filterByBoolMask_2 = List.FilterByBoolMask(list=all_elements_of_category, mask=contains_3)

# group: Alle deuren linksdraaiend benoemen
code_block_4 = CodeBlock { "NLRS_C_montage"; }
code_block_5 = CodeBlock { "linksdraaiend"; }
setParameterByName = Element.SetParameterByName(element=filterByBoolMask_2.in, parameterName=code_block_4, value=code_block_5)

code_block_6 = CodeBlock(passthrough=byName, waitfor=setParameterByName) { [passthrough,waitfor][0]; }

# group: Vind alle gespiegelde deuren
all_elements_of_category_2 = ElementsOfCategory(Category=code_block_6)
python_script_2 = Python(IN[0]=all_elements_of_category_2)
# ---------- python_script_2.python (16 lines) ----------
import clr
clr.AddReference('ProtoGeometry')
from Autodesk.DesignScript.Geometry import *

# Import RevitAPI
clr.AddReference('RevitAPI')
import Autodesk

items=UnwrapElement(IN[0])

mirs = []
for i in items:
	if i.Mirrored == True :
		mirs.append(i)	
#Assign your output to the OUT variable
OUT = mirs
# ----------------------------------------

# group: Gespiegelde deuren rechtsdraaiend benoemen
code_block_7 = CodeBlock { "NLRS_C_montage"; }
code_block_8 = CodeBlock { "rechtsdraaiend"; }
setParameterByName_2 = Element.SetParameterByName(element=python_script_2, parameterName=code_block_7, value=code_block_8)

# group: SCOPE BOXES - Hier worden alle Scope Boxes uitgefilterd die de benaming "bnr" hebben
builtInCategory_3 = CodeBlock { "OST_VolumeOfInterest"; }
byName_3 = Category.ByName(name=builtInCategory_3)
all_elements_of_category_3 = ElementsOfCategory(Category=byName_3)
name_4 = Element.Name(element=all_elements_of_category_3)
code_block_9 = CodeBlock { "bnr"; }
contains_4 = String.Contains(str=name_4, searchFor=code_block_9)
filterByBoolMask_3 = List.FilterByBoolMask(list=all_elements_of_category_3, mask=contains_4)
name_5 = Element.Name(element=filterByBoolMask_3.in)

# group: Elementen in de Scope Boxes filteren op NLRS_32
boundingBox = Element.BoundingBox(element=filterByBoolMask_3.in)
python_script_3 = Python(IN[0]=boundingBox)
# ---------- python_script_3.python (36 lines) ----------
import clr
clr.AddReference('RevitAPI')
clr.AddReference('System')
clr.AddReference('RevitNodes')
clr.AddReference('RevitServices')
import Revit
import RevitServices
from Autodesk.Revit.DB import *
from System.Collections.Generic import List
from RevitServices.Persistence import DocumentManager
from RevitServices.Transactions import TransactionManager
clr.ImportExtensions(Revit.Elements)
clr.ImportExtensions(Revit.GeometryConversion)
doc = DocumentManager.Instance.CurrentDBDocument

#Functions for list handling
def ProcessList(_func, _list):
   return map( lambda x: ProcessList(_func, x) if type(x)==list else _func(x), _list )

#Preparing input from dynamo to revit

def ToRevit(item):
	return item.ToRevitType(True)

if isinstance(IN[0], list):
	bblist = ProcessList(ToRevit, IN[0])
else:
	bblist = [ToRevit(IN[0])]

def collectElementsInBB(bb):
	outline = Outline(bb.Min, bb.Max)
	filter = BoundingBoxIntersectsFilter(outline)
	collector = FilteredElementCollector(doc, doc.ActiveView.Id).WherePasses(filter)
	return [e.ToDSType(True) for e in collector]

OUT = ProcessList(collectElementsInBB, bblist)
# ----------------------------------------
code_block_10 = CodeBlock { "Family"; }
getParameterValueByName = Element.GetParameterValueByName(element=python_script_3, parameterName=code_block_10)
string_from_object = FromObject(obj=getParameterValueByName)
code_block_11 = CodeBlock { "NLRS_32_"; }
contains_5 = String.Contains(str=string_from_object, searchFor=code_block_11)
filterByBoolMask_4 = List.FilterByBoolMask(list=python_script_3, mask=contains_5)

# group: bouwnummers worden toegevoegd
code_block_12 = CodeBlock { "NLRS_C_bouwwerk_nummer"; }
setParameterByName_3 = Element.SetParameterByName(element=filterByBoolMask_4.in, parameterName=code_block_12, value=name_5)
