# Dynamo graph 2.0.2 - IFC Export.dyn "2.02 - IFC Export" (Dynamo 2.0.2.6826)

# note: Nodes not to consider part of the final graph

# group: NOTES
# note: INSTRUCTIONS
# - Betreft 3D Views in browsermap 99 en 100 export.
# note: GENERAL INFO
# Version: 1.0.0
# Author: Yahya Kiliç
# Company: Dura Vermeer
# email: y.kilic@duravermeer.nl
# Dynamo version: 2.0.2
# Revit version: 2018.3
# note: UITGANGSPUNTEN
#  - De script is voor meerdere views exports naar IFC

# group: FUNCTION
# note: Data manipulation on Dynamo objects

# group: DEBUG
# note: Check if the graph is working as expected

# group: INPUT
# note: Data input and preparation for other nodes

# group: OUTPUT
# note: Objects creation in Revit, final output

# group: SET
# note: Set parameters on Revit objects

# group: GET
# note: Get parameter values from Revit objects

# group: Locatie map van alle IFC's
directory_path = Directory("No file selected.")  # graph input

# group: Selecteer alle 3D Views
element_types = ElementTypes(index=326)
all_elements_of_type = ElementsOfType(element_type=element_types)
isNull = Object.IsNull(obj=all_elements_of_type)
filterByBoolMask = List.FilterByBoolMask(list=all_elements_of_type, mask=isNull)

# group: Selecteer 3D views in 99 of 100 export
code_block = CodeBlock { "browsermap_hoofd"; }
getParameterValueByName = Element.GetParameterValueByName(element=filterByBoolMask.out, parameterName=code_block)
vul_99_of_100_in_voor_export_3d = StringInput("99")  # "Vul 99 of 100 in voor export 3D Views"; graph input
code_block_2 = CodeBlock { "_export"; }
code_block_3 = CodeBlock(a=vul_99_of_100_in_voor_export_3d, b=code_block_2) { a+b; }
contains = String.Contains(str=getParameterValueByName, searchFor=code_block_3)
filterByBoolMask_2 = List.FilterByBoolMask(list=filterByBoolMask.out, mask=contains)

# group: Export IFC
code_block_4 = CodeBlock(item=filterByBoolMask_2.in) { DSCore.List.Flatten(item,-1); }
# note: IFC Version :
# "IFC2x2";
# "IFC2x3";
# "IFC2x3CV2";
# "IFC2x2";
# "IFC4";
# "IFCBCA";
# "IFCCOBIE";
code_block_5 = CodeBlock { "IFC2x3"; }
code_block_6 = CodeBlock { "3"; }
boolean = BoolSelector(false)

# group: IFC bestandsnaam
code_block_7 = CodeBlock { "View Name"; }
getParameterValueByName_2 = Element.GetParameterValueByName(element=filterByBoolMask_2.in, parameterName=code_block_7)

export_ifc = Custom[Export IFC](DirectoryPath=directory_path, Views_as_list_Views=code_block_4, Filename=getParameterValueByName_2, IFCversion=code_block_5, ProjectOrigin=code_block_6, WallAndColumnSplitting=boolean, ExportBaseQuantities=boolean)  # Export multiple views to IFC file. The Project Origin option works only with Revit 2018 and above. Some other IFC options are embedded inside the python script.
