# Dynamo custom node IFC Export.dyf "Export IFC" (Dynamo 2.0.1.5055)
# category: Dura Vermeer.Export
# Export multiple views to IFC file.
# The Project Origin option works only with Revit 2018 and above.
# Some other IFC options are embedded inside the python script.

DirectoryPath = Input(DirectoryPath: var[]..[])
Filename = Input(Filename: var[]..[])  # Filename as list
code_block = CodeBlock(item=Filename) { DSCore.List.Flatten(item,-1); }
Views_as_list_Views = Input(//Views as list Views: var[]..[])
IFCversion = Input(IFCversion: string = "IFC2x3")  # IFC Version
# note: IFC Version :
# "IFC2x2";
# "IFC2x3";
# "IFC2x3CV2";
# "IFC2x2";
# "IFC4";
# "IFCBCA";
# "IFCCOBIE";
WallAndColumnSplitting = Input(WallAndColumnSplitting: bool = false)
ExportBaseQuantities = Input(ExportBaseQuantities: bool = false)
ProjectOrigin = Input(ProjectOrigin: string = "3")  # SharedCoordinates ="0", SiteSurveyPoint ="1", ProjectBasePoint="2", InternalCoordinates="3"
export_ifc = Python(IN[0]=DirectoryPath, IN[1]=code_block, IN[2]=Views_as_list_Views, IN[3]=IFCversion, IN[4]=WallAndColumnSplitting, IN[5]=ExportBaseQuantities, IN[6]=ProjectOrigin)
# ---------- export_ifc.python (98 lines) ----------
import clr
clr.AddReference('ProtoGeometry')
from Autodesk.DesignScript.Geometry import *
# Import ToDSType(bool) extension method
clr.AddReference("RevitNodes")
import Revit
clr.ImportExtensions(Revit.Elements)
# Import geometry conversion extension methods
clr.ImportExtensions(Revit.GeometryConversion)
# Import DocumentManager and TransactionManager
clr.AddReference("RevitServices")
import RevitServices
from RevitServices.Persistence import DocumentManager
from RevitServices.Transactions import TransactionManager
from System.Collections.Generic import *
# Import RevitAPI
clr.AddReference("RevitAPI")
import Autodesk
from Autodesk.Revit.DB import *

doc = DocumentManager.Instance.CurrentDBDocument
uiapp = DocumentManager.Instance.CurrentUIApplication
app = uiapp.Application
uidoc=DocumentManager.Instance.CurrentUIApplication.ActiveUIDocument

folder=UnwrapElement(IN[0])
name=UnwrapElement(IN[1])
view = UnwrapElement(IN[2])
fileversion = IN[3]
wallandcolumnsplitting = IN[4]
exportbasequantities = IN[5]
Projectorigin = IN[6]

#IFCVersion=UnwrapElement(IN[3])

TransactionManager.Instance.EnsureInTransaction(doc)
result = []

for i,v in enumerate(view):
	options=IFCExportOptions()
	
	#if fileversion != None:
	#	options.FileVersion = fileversion
	if fileversion == "IFC4":
		options.FileVersion = IFCVersion.IFC4
	if fileversion == "IFC2x2":
		options.FileVersion = IFCVersion.IFC2x2
	if fileversion == "IFC2x3":
		options.FileVersion = IFCVersion.IFC2x3
	if fileversion == "IFC2x3CV2":
		options.FileVersion = IFCVersion.IFC2x3CV2
	if fileversion == "IFCBCA":
		options.FileVersion = IFCVersion.IFCBCA
	if fileversion == "IFCCOBIE":
		options.FileVersion = IFCVersion.IFCCOBIE
	if fileversion == "":
		options.FileVersion = IFCVersion.Default
		
	options.WallAndColumnSplitting = wallandcolumnsplitting
	options.ExportBaseQuantities = exportbasequantities
	options.FilterViewId = v.Id
	options.AddOption("ExportInternalRevitPropertySets","false");
	options.AddOption("ExportIFCCommonPropertySets","true");
	options.AddOption("ExportBaseQuantities","true");	
	options.AddOption("ExportAnnotations ","false");
	options.AddOption("SpaceBoundaries ", "2");
	options.AddOption("ExportRoomsInView", "false");	
	options.AddOption("Use2DRoomBoundaryForVolume ", "false");
	options.AddOption("UseFamilyAndTypeNameForReference", "false");
	options.AddOption("Export2DElements", "false");
	options.AddOption("ExportPartsAsBuildingElements", "false");
	options.AddOption("ExportBoundingBox", "false");
	options.AddOption("ExportSolidModelRep", "false");
	options.AddOption("ExportSchedulesAsPsets", "false");
	options.AddOption("ExportSpecificSchedules", "false");
	#Doesn't work. It would be necessary to use OpenInBackground.
	options.AddOption("ExportLinkedFiles", "false");
	options.AddOption("IncludeSiteElevation","false");
	options.AddOption("StoreIFCGUID", "false");
	options.AddOption("VisibleElementsOfCurrentView", "true");
	options.AddOption("UseActiveViewGeometry", "false");
	options.AddOption("TessellationLevelOfDetail", "1");
 	options.AddOption("ExportUserDefinedPsets","true");
	options.AddOption("ExportUserDefinedPsetsFileName","B:\Settings\RVT_Export\Property Mapping_Dura.txt"); 	
 	options.AddOption("SitePlacement", IN[6]);
#IFCVersion Version = (IFCVersion) Enum.Parse( typeof(IFCVersion), UnwrapElement(IN[3]), true );
#x.FileVersion = IFCVersion.IFC2x3CV2

	c=doc.Export(folder, name[i], options)
	result.append(c)

# End Transaction
TransactionManager.Instance.TransactionTaskDone()

if fileversion == "":
	OUT="Default settings used"
else:
	OUT='Success'
# ----------------------------------------
Succeed = Output(export_ifc)
