# Dynamo graph 2.0.2 - Deel 1_Creëren Dependent Views.dyn (Dynamo 2.0.2.6826)

# group: GET
# note: Get parameter values from Revit objects

# group: INPUT
# note: Data input and preparation for other nodes

# group: FUNCTION
# note: Data manipulation on Dynamo objects

# group: OUTPUT
# note: Objects creation in Revit, final output

# group: SET
# note: Set parameters on Revit objects

# group: DEBUG
# note: Check if the graph is working as expected

# group: NOTES
# note: INSTRUCTIONS
# - Scope Boxes Name moeten op de volgende manier worden ingevuld: bnr spatiebalk bouwnummer
# - Bij Floorplans moet het dak op de volgende manier worden ingevuld: 03_dak
# - Er mogen geen Dependent views zijn in 03_verkoop. Die worden automatisch gegenereerd
# note: GENERAL INFO
# Version: 1.0.0
# Author: Yahya Kiliç
# Company: Dura Vermeer
# email: y.kilic@duravermeer.nl
# Dynamo version: 2.0.2
# Revit version: 2018.3
# note: UITGANGSPUNTEN
#  - De script is alleen bedoeld voor verkoopscheets

# group: Floorplans: 03_verkoop - Hier worden alle Floorplans van 03_verkoop uitgefilterd.
builtInCategory = CodeBlock { "OST_Views"; }
# note: Nodes not to consider part of the final graph
byName = Category.ByName(name=builtInCategory)
all_elements_of_category = ElementsOfCategory(Category=byName)
isNull = Object.IsNull(obj=all_elements_of_category)
filterByBoolMask = List.FilterByBoolMask(list=all_elements_of_category, mask=isNull)
code_block = CodeBlock { "browsermap_hoofd"; }
getParameterValueByName = Element.GetParameterValueByName(element=filterByBoolMask.out, parameterName=code_block)
code_block_2 = CodeBlock { "03"; }
contains = String.Contains(str=getParameterValueByName, searchFor=code_block_2)
filterByBoolMask_2 = List.FilterByBoolMask(list=filterByBoolMask.out, mask=contains)
name = Element.Name(element=filterByBoolMask_2.in)
code_block_3 = CodeBlock { "begane grond"; "verdieping"; "dak"; }
contains_2 = String.Contains(str=name, searchFor=code_block_3.out0)
contains_3 = String.Contains(str=name, searchFor=code_block_3.out1)
contains_4 = String.Contains(str=name, searchFor=code_block_3.out2)
create = List.Create(item0=contains_2, item1=contains_3, item2=contains_4)
filterByBoolMask_3 = List.FilterByBoolMask(list=filterByBoolMask_2.in, mask=create@L2)
flatten = List.Flatten(list=filterByBoolMask_3.in)

# group: SCOPE BOXES - Hier worden alle Scope Boxes uitgefilterd die de benaming "bnr" hebben
builtInCategory_2 = CodeBlock { "OST_VolumeOfInterest"; }
byName_2 = Category.ByName(name=builtInCategory_2)
all_elements_of_category_2 = ElementsOfCategory(Category=byName_2)
name_2 = Element.Name(element=all_elements_of_category_2)
code_block_4 = CodeBlock { "bnr"; }
contains_5 = String.Contains(str=name_2, searchFor=code_block_4)
filterByBoolMask_4 = List.FilterByBoolMask(list=all_elements_of_category_2, mask=contains_5)
name_3 = Element.Name(element=filterByBoolMask_4.in)

# group: Dependent Views - Hier krijgen alle Dependent Views de juiste benaming met behulp van aantal Scope Boxes en Floor PLans
name_4 = Element.Name(element=flatten)
code_block_5 = CodeBlock { 0; }
code_block_6 = CodeBlock { 3; }
remove = String.Remove(str=name_4, startIndex=code_block_5, count=code_block_6)
count = List.Count(list=flatten)
ofRepeatedItem = List.OfRepeatedItem(item=name_3, amount=count)
code_block_7 = CodeBlock { 0; }
code_block_8 = CodeBlock { "_"; }
insert = String.Insert(str=ofRepeatedItem, index=code_block_7, toInsert=code_block_8)
code_block_9 = CodeBlock(a=remove, b=insert) { a+b; }

# group: Hier worden alle Dependent Views gegenereerd
python_script = Python(IN[0]=flatten, IN[1]=code_block_9)
# ---------- python_script.python (32 lines) ----------
import clr
clr.AddReference('RevitAPI')
from Autodesk.Revit.DB import *
import Autodesk

clr.AddReference("RevitServices")
import RevitServices
from RevitServices.Persistence import DocumentManager
from RevitServices.Transactions import TransactionManager

def DuplicateView(view, name, doc):
	try:
		newViewId = view.Duplicate(Autodesk.Revit.DB.ViewDuplicateOption.AsDependent)
		newView = doc.GetElement(newViewId)
		try: newView.Name = name
		except: pass
		return newView
	except: return None

doc = DocumentManager.Instance.CurrentDBDocument
views = UnwrapElement(IN[0])

TransactionManager.Instance.EnsureInTransaction(doc)
if isinstance(IN[0], list):
	OUT = []
	for view, name in zip(views, IN[1]):
		if isinstance(name, list): OUT.append([DuplicateView(view, x, doc) for x in name])
		else: OUT.append(DuplicateView(view, name, doc))
else: 
	if isinstance(IN[1], list): OUT = [DuplicateView(views, x, doc) for x in IN[1]]
	else: OUT = DuplicateView(views, IN[1], doc)
TransactionManager.Instance.TransactionTaskDone()
# ----------------------------------------

# group: Dependent Views met Scope Boxes - Hier worden op alle Dependent Views de juiste Scope Boxes aangehangen
code_block_10 = CodeBlock { "Scope Box"; }
setParameterByName = Element.SetParameterByName(element=python_script@L2, parameterName=code_block_10, value=filterByBoolMask_4.in)
flatten_2 = List.Flatten(list=setParameterByName)

# group: Crop Region Visible - Schakelt deze functie uit.
code_block_11 = CodeBlock { "Crop Region Visible"; }
boolean = BoolSelector(false)
setParameterByName_2 = Element.SetParameterByName(element=flatten_2, parameterName=code_block_11, value=boolean)
