# Dynamo graph 2.0.2 - Deel 2_Verkoop Sheets.dyn "2.02 - Deel 2_Verkoop Sheets" (Dynamo 2.0.2.6826)

# note: Nodes not to consider part of the final graph

# group: GET
# note: Get parameter values from Revit objects

# group: INPUT
# note: Data input and preparation for other nodes

# group: FUNCTION
# note: Data manipulation on Dynamo objects

# group: OUTPUT
# note: Objects creation in Revit, final output

# group: SET
# note: Set parameters on Revit objects

# group: DEBUG
# note: Check if the graph is working as expected

# group: NOTES
# note: GENERAL INFO
# Version: 1.0.0
# Author: Yahya Kiliç
# Company: Dura Vermeer
# email: y.kilic@duravermeer.nl
# Dynamo version: 2.0.2
# Revit version: 2018.3
# note: INSTRUCTIONS
# - Scope Boxes Name moeten op de volgende manier worden ingevuld: bnr spatiebalk bouwnummer
# - Bij Floorplans moet het dak op de volgende manier worden ingevuld: 03_dak
# - Er mogen geen Dependent views zijn in 03_verkoop. Die worden automatisch gegenereerd
# - Locatie in browser bij Sheets:
# Verkoop --> Bouwkundig
# note: UITGANGSPUNTEN
#  - De script is alleen bedoeld voor verkoopscheets

# group: Selectie DependentViews 03_verkoop
builtInCategory = CodeBlock { "OST_Views"; }
byName = Category.ByName(name=builtInCategory)
all_elements_of_category = ElementsOfCategory(Category=byName)
isNull = Object.IsNull(obj=all_elements_of_category)
filterByBoolMask = List.FilterByBoolMask(list=all_elements_of_category, mask=isNull)
name = Element.Name(element=filterByBoolMask.out)
code_block = CodeBlock { "bnr"; }
contains = String.Contains(str=name, searchFor=code_block)
filterByBoolMask_2 = List.FilterByBoolMask(list=filterByBoolMask.out, mask=contains)

# group: SheetNumber & SheetName: - Verzamelen van data voor manipulatie - Data is afkomstig van View Name (Floor PLans - Dependent Views
name_2 = Element.Name(element=filterByBoolMask_2.in)

# group: Begane grond - Hier wordt de begane grond uitgefilterd voor verdere manipulatie
code_block_2 = CodeBlock { "begane grond"; }
contains_2 = String.Contains(str=name_2, searchFor=code_block_2)
filterByBoolMask_3 = List.FilterByBoolMask(list=name_2, mask=contains_2)

# group: Verdiepingen - Hier worden alle verdiepingen uitgefilterd voor verdere manipulatie
code_block_3 = CodeBlock { "verdieping"; }
contains_3 = String.Contains(str=name_2, searchFor=code_block_3)
filterByBoolMask_4 = List.FilterByBoolMask(list=name_2, mask=contains_3)

# group: Dak - Hier wordt het dak uitgefilterd voor verdere manipulatie
code_block_4 = CodeBlock { "dak"; }
contains_4 = String.Contains(str=name_2, searchFor=code_block_4)
filterByBoolMask_5 = List.FilterByBoolMask(list=name_2, mask=contains_4)

# group: SheetName - Hier worden de data gemanipuleerd voor SheetName.
code_block_5 = CodeBlock { "b"; }
code_block_6 = CodeBlock { "B"; }
replace = String.Replace(str=filterByBoolMask_3.in, searchFor=code_block_5, replaceWith=code_block_6)
code_block_7 = CodeBlock { "_Bnr"; " bouwnummer"; }
replace_2 = String.Replace(str=replace, searchFor=code_block_7.out0, replaceWith=code_block_7.out1)
code_block_8 = CodeBlock { "_bnr"; " bouwnummer"; }
replace_3 = String.Replace(str=filterByBoolMask_4.in, searchFor=code_block_8.out0, replaceWith=code_block_8.out1)
code_block_9 = CodeBlock { "d"; "D"; }
replace_4 = String.Replace(str=filterByBoolMask_5.in, searchFor=code_block_9.out0, replaceWith=code_block_9.out1)
code_block_10 = CodeBlock { "_bnr"; " bouwnummer"; }
replace_5 = String.Replace(str=replace_4, searchFor=code_block_10.out0, replaceWith=code_block_10.out1)
create = List.Create(item0=replace_2, item1=replace_3, item2=replace_5)
flatten = List.Flatten(list=create)

# group: Level Dak - Voor het geval er 3e of 4e verdieping bijkomt en het dak hoger komt te liggen.
builtInCategory_2 = CodeBlock { "OST_Levels"; }
byName_2 = Category.ByName(name=builtInCategory_2)
all_elements_of_category_2 = ElementsOfCategory(Category=byName_2)
name_3 = Element.Name(element=all_elements_of_category_2)
sort = List.Sort(list=name_3)
lastItem = List.LastItem(list=sort)
code_block_11 = CodeBlock { 0; }
code_block_12 = CodeBlock { 2; }
substring = String.Substring(str=lastItem, startIndex=code_block_11, length=code_block_12)
toNumber = String.ToNumber(str=substring)
string_from_object = FromObject(obj=toNumber)

# group: SheetNumber Levels - Hier worden alle levels verzameld voor de SheetNumber.
code_block_13 = CodeBlock { 0; }
code_block_14 = CodeBlock { 1; }
substring_2 = String.Substring(str=name_2, startIndex=code_block_13, length=code_block_14)
code_block_15 = CodeBlock { "b"; }
code_block_16 = CodeBlock { "0"; }
replace_6 = String.Replace(str=substring_2, searchFor=code_block_15, replaceWith=code_block_16)
code_block_17 = CodeBlock { "d"; }
replace_7 = String.Replace(str=replace_6, searchFor=code_block_17, replaceWith=string_from_object)
code_block_18 = CodeBlock { 0; }
code_block_19 = CodeBlock { "-"; }
insert = String.Insert(str=replace_7, index=code_block_18, toInsert=code_block_19)

# group: Sheetnumber Begane grond - Hier krijgen zij de juiste SheetNumber, afhankelijk van de bouwnummer
code_block_20 = CodeBlock { 0; }
code_block_21 = CodeBlock { 17; }
remove = String.Remove(str=filterByBoolMask_3.in, startIndex=code_block_20, count=code_block_21)
code_block_22 = CodeBlock { 0; }
toNumber_2 = String.ToNumber(str=remove)
code_block_23 = CodeBlock(BNR=toNumber_2) { BNR>=100?"VK-":"VK-0"; }
insert_2 = String.Insert(str=remove, index=code_block_22, toInsert=code_block_23)

# group: SheetNumber Verdiepingen - Hier krijgen zij de juiste SheetNumber, afhankelijk van de bouwnummer
code_block_24 = CodeBlock { 0; }
code_block_25 = CodeBlock { 18; }
remove_2 = String.Remove(str=filterByBoolMask_4.in, startIndex=code_block_24, count=code_block_25)
code_block_26 = CodeBlock { 0; }
toNumber_3 = String.ToNumber(str=remove_2)
code_block_27 = CodeBlock(BNR=toNumber_3) { BNR>=100?"VK-":"VK-0"; }
insert_3 = String.Insert(str=remove_2, index=code_block_26, toInsert=code_block_27)

# group: SheetNumber Dak - Hier krijgen zij de juiste SheetNumber, afhankelijk van de bouwnummer
code_block_28 = CodeBlock { 0; }
code_block_29 = CodeBlock { 8; }
remove_3 = String.Remove(str=filterByBoolMask_5.in, startIndex=code_block_28, count=code_block_29)
code_block_30 = CodeBlock { 0; }
toNumber_4 = String.ToNumber(str=remove_3)
code_block_31 = CodeBlock(BNR=toNumber_4) { BNR>=100?"VK-":"VK-0"; }
insert_4 = String.Insert(str=remove_3, index=code_block_30, toInsert=code_block_31)

# group: SheetNumber -Alle Sheetnumbers + Levels worden samengevoegd
code_block_32 = CodeBlock { 0; }
create_2 = List.Create(item0=insert_2, item1=insert_3, item2=insert_4)
flatten_2 = List.Flatten(list=create_2)
insert_5 = String.Insert(str=insert, index=code_block_32, toInsert=flatten_2)

# group: Creating Sheets - Hier worden de A3-Sheets gegenereerd met juiste benaming en views
selecteer_het_gewenste = FamilyTypes(index=196)  # "Selecteer het gewenste papierformaat"; graph input
byNameNumberTitleBlockAndView = Sheet.ByNameNumberTitleBlockAndView(sheetName=flatten, sheetNumber=insert_5, titleBlockFamilyType=selecteer_het_gewenste, view=filterByBoolMask_2.in)

# group: Positie Project Browser - Hier worden de Sheets op de juiste plek gezet in de Project Browser
code_block_33 = CodeBlock { "NLRS_C_tekening_discipline"; "Verkoop"; }
setParameterByName = Element.SetParameterByName(element=byNameNumberTitleBlockAndView, parameterName=code_block_33.out0, value=code_block_33.out1)
code_block_34 = CodeBlock { "browsermap_hoofd"; "Bouwkundig"; }
setParameterByName_2 = Element.SetParameterByName(element=setParameterByName, parameterName=code_block_34.out0, value=code_block_34.out1)

viewport_py = Python(IN[0]=byNameNumberTitleBlockAndView)
# ---------- viewport_py.python (48 lines) ----------
#This Python Script has been adapted from a similar node in the SpringNodes package for use by LinkedIn Learning.

import clr
clr.AddReference('ProtoGeometry')
from Autodesk.DesignScript.Geometry import *
# Import ToDSType(bool) extension method
clr.AddReference("RevitNodes")
import Revit
clr.ImportExtensions(Revit.Elements)
# Import geometry conversion extension methods
clr.ImportExtensions(Revit.GeometryConversion)
# Import DocumentManager and TransactionManager
clr.AddReference("RevitServices")
import RevitServices
from RevitServices.Persistence import DocumentManager
from RevitServices.Transactions import TransactionManager
from System.Collections.Generic import *
# Import RevitAPI
clr.AddReference("RevitAPI")
import Autodesk
from Autodesk.Revit.DB import *

doc = DocumentManager.Instance.CurrentDBDocument
uiapp = DocumentManager.Instance.CurrentUIApplication
app = uiapp.Application
uidoc=DocumentManager.Instance.CurrentUIApplication.ActiveUIDocument

sheets = []
for i in IN[0]:
	sheets.append(UnwrapElement(i))

# Start Transaction
TransactionManager.Instance.EnsureInTransaction(doc)

vplist=[]
for v in sheets:
	vp=[]
	a=v.GetAllViewports()
	for i in a:
		b=doc.GetElement(i)
		vp.append(b)
	vplist.append(vp)
			

# End Transaction
TransactionManager.Instance.TransactionTaskDone()

OUT=vplist
# ----------------------------------------

# group: Views verplaatsen - Hier worden alle Views verplaats naar de aangegeven coördinaten
flatten_3 = List.Flatten(list=viewport_py)
x_as_viewport = DoubleSlider(910, range=0..2500 step 1)  # graph input
y_as_viewport = DoubleSlider(65, range=0..2500 step 1)  # graph input
byCoordinates = Vector.ByCoordinates(x=x_as_viewport, y=y_as_viewport)
moveByVector = Element.MoveByVector(element=flatten_3, vector=byCoordinates)

# group: Geen Titel (VIEWPORT) - Hier worden de titels van de Viewport omgezet naar "geen titel"
code_block_35 = CodeBlock { "Type"; "geen titel"; }
element_types = ElementTypes(index=96)
all_elements_of_type = ElementsOfType(element_type=element_types)
name_4 = Element.Name(element=all_elements_of_type)
code_block_36 = CodeBlock { "geen titel"; }
contains_5 = String.Contains(str=name_4, searchFor=code_block_36)
filterByBoolMask_6 = List.FilterByBoolMask(list=all_elements_of_type, mask=contains_5)
setParameterByName_3 = Element.SetParameterByName(element=flatten_3, parameterName=code_block_35.out0, value=filterByBoolMask_6.in@L1)

# group: Legend op Sheets - Hier worden de legends op sheets geplaatst en met coördinaten op de juiste positie gezet
legend_view_name = StringInput("DV - Renvooi Dura Vermeer Zuid West verkoop 1/100")  # graph input
get_view_by_name_py = Python(IN[0]=legend_view_name)
# ---------- get_view_by_name_py.python (30 lines) ----------
import clr
# import Document Manager
clr.AddReference("RevitServices")
import RevitServices 
from RevitServices.Persistence import DocumentManager
from RevitServices.Transactions import TransactionManager
doc = DocumentManager.Instance.CurrentDBDocument
uidoc = DocumentManager.Instance.CurrentUIDocument
clr.AddReference("RevitNodes")
import Revit
clr.ImportExtensions(Revit.Elements)
clr.ImportExtensions(Revit.GeometryConversion)
clr.AddReference("RevitAPI")
from Autodesk.Revit.DB import *

dataEnteringNode = IN
vName = IN[0]
foundView = None

coll = FilteredElementCollector(doc)
views = coll.OfClass(View)

for v in views:
	view = UnwrapElement(v)
	if v.Name == vName:
		foundView = v
	
OUT = foundView
	
#For more information refer to RBG Wiki or email me (ctrl + click link): daniel.woodcock@robertbird.com
# ----------------------------------------
x_as_legend = DoubleSlider(0.71, range=0..1 step 1.11)
y_as_legend = DoubleSlider(0.86, range=0..2.5 step 1.11)
byCoordinates_2 = Vector.ByCoordinates(x=x_as_legend, y=y_as_legend)
place_legend_on_sheets_py = Python(IN[0]=get_view_by_name_py, IN[1]=byNameNumberTitleBlockAndView, IN[2]=byCoordinates_2)
# ---------- place_legend_on_sheets_py.python (40 lines) ----------
import clr
# import Document Manager
clr.AddReference("RevitServices")
import RevitServices 
from RevitServices.Persistence import DocumentManager
from RevitServices.Transactions import TransactionManager
doc = DocumentManager.Instance.CurrentDBDocument
uidoc = DocumentManager.Instance.CurrentUIDocument
clr.AddReference("RevitNodes")
import Revit
clr.ImportExtensions(Revit.Elements)
clr.ImportExtensions(Revit.GeometryConversion)
clr.AddReference("RevitAPI")
from Autodesk.Revit.DB import *

dataEnteringNode = IN

legend = UnwrapElement(IN[0])
sheets = IN[1]
loc = XYZ(IN[2].X, IN[2].Y, IN[2].Z)
viewports = []
failed = []

for vs in sheets:
	sheet = UnwrapElement(vs)
	canAddToSht = Viewport.CanAddViewToSheet(doc, sheet.Id, legend.Id)
	if canAddToSht:
		try:		
			TransactionManager.Instance.EnsureInTransaction(doc)	
			viewport = Viewport.Create(doc, sheet.Id, legend.Id, loc)	
			TransactionManager.Instance.TransactionTaskDone()
			viewports.Add([viewport,sheet])
		except:
			failed.Add(["Failed",sheet])
	else:
		failed.Add(["Failed",sheet])
		
OUT = [viewports, failed]
	
#For more information refer to RBG Wiki or email me (ctrl + click link): daniel.woodcock@robertbird.com
# ----------------------------------------
succeeded = CodeBlock(a=place_legend_on_sheets_py) { a[0]; }
failed = CodeBlock(a=place_legend_on_sheets_py) { a[1]; }

# group: Stempel - Hier kan men de stempel invullen van de Sheets
code_block_37 = CodeBlock { "NLRS_C_tekening_formaat"; }
formaat = StringInput("A3")  # graph input
setParameterByName_4 = Element.SetParameterByName(element=byNameNumberTitleBlockAndView, parameterName=code_block_37, value=formaat)
code_block_38 = CodeBlock { "NLRS_C_tekening_schaal"; }
schaal = StringInput("1:50")  # graph input
setParameterByName_5 = Element.SetParameterByName(element=byNameNumberTitleBlockAndView, parameterName=code_block_38, value=schaal)
code_block_39 = CodeBlock { "dv-status"; }
status = StringInput("Concept")  # graph input
setParameterByName_6 = Element.SetParameterByName(element=byNameNumberTitleBlockAndView, parameterName=code_block_39, value=status)
code_block_40 = CodeBlock { "Sheet Issue Date"; }
datum = StringInput("xx-xx-xxxx")  # graph input
setParameterByName_7 = Element.SetParameterByName(element=byNameNumberTitleBlockAndView, parameterName=code_block_40, value=datum)
code_block_41 = CodeBlock { "Drawn By"; }
modelleur = StringInput("Author")  # graph input
setParameterByName_8 = Element.SetParameterByName(element=byNameNumberTitleBlockAndView, parameterName=code_block_41, value=modelleur)
code_block_42 = CodeBlock { "Checked By"; }
gecontroleerd_door = StringInput("Checker")  # graph input
setParameterByName_9 = Element.SetParameterByName(element=byNameNumberTitleBlockAndView, parameterName=code_block_42, value=gecontroleerd_door)
code_block_43 = CodeBlock { "NLRS_C_tekening_onderwerp2"; }
bloknummer = StringInput("Blok ")  # graph input
setParameterByName_10 = Element.SetParameterByName(element=byNameNumberTitleBlockAndView, parameterName=code_block_43, value=bloknummer)
